# Grasshopper definition S2-intro-to-graphs.gh (Grasshopper 1.0.8)

list = ValueList({"graphs-01-intro": 0, "graphs-02-graph-from-mesh": 1, "graphs-03-with-data": 2, "graphs-04-dual-graph": 3, "graphs-05-shorest-paths": 4}, selected="graphs-05-shorest-paths")
graphs_02_graph_from_mesh = FilePath("C:\Users\57301\Desktop\Maestría\Second Semester\AT PY\Session02\MPDA25-Session02\graphs\graphs-02-graph-from-mesh.py")
graphs_05_shorest_paths = FilePath("C:\Users\57301\Desktop\Maestría\Second Semester\AT PY\Assignment 3\MPDA25-Assignment3\graphs-05-shorest-paths.py")
graphs_04_dual_graph = FilePath("C:\Users\57301\Desktop\Maestría\Second Semester\AT PY\Session02\MPDA25-Session02\graphs\graphs-04-dual-graph.py")
graphs_03_with_data = FilePath("C:\Users\57301\Desktop\Maestría\Second Semester\AT PY\Session02\MPDA25-Session02\graphs\graphs-03-with-data.py")
graphs_01_intro = FilePath("C:\Users\57301\Desktop\Maestría\Second Semester\AT PY\Session02\MPDA25-Session02\graphs\graphs-01-intro.py")
number_slider = Slider(10, range=0..10)
filter = StreamFilter(
    Gate=list,
    Stream0=graphs_01_intro,
    Stream1=graphs_02_graph_from_mesh,
    Stream2=graphs_03_with_data,
    Stream3=graphs_04_dual_graph,
    Stream4=graphs_05_shorest_paths)
mplane = MeshPlane(
    Boundary={Plane=PlaneXY(0, 0, 0), Size=Domain2(u=-10..10, v=-10..10)},
    WidthCount=number_slider,
    HeightCount=number_slider)  # -> Mesh, Area
panel = Panel(filter)
group_mesh = Mesh(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)
file = ReadFile(File=filter, PerLineParse=False)
trimesh = Mesh(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)
quadmesh = Mesh(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)
demesh = DeconstructMesh(Mesh=group_mesh)  # -> Vertices, Faces, Colours, Normals
conmesh = ConstructMesh(Vertices=demesh.Vertices, Faces=graft(demesh.Faces))  # -> flatten(Mesh)
py3 = Python3Script(script=file, m=group_mesh, s=Slider(6, range=0..10), t=Slider(55, range=0..90))  # -> out, a, b, c; inputs m: Mesh, s: Int32, t: Int32; unedited script template
item = ListItem(List=conmesh, Index=py3.c, Wrap=True)
panel_2 = Panel(py3.c)
preview = CustomPreview(
    Geometry=item,
    Material={diffuse=RGB(221, 160, 221), emission=RGB(66, 48, 66), shine=0.5, specular=RGB(255, 255, 255), transparency=0})
